# Grasshopper definition ImageRegionSelector.gh (Grasshopper 0.9.76)
# plug-ins: Python Interpreter

ladybug = Ladybug_Ladybug()  # -> Vviiiiiiiiiizzz; plug-in component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
path = FilePath("C:\Users\cmackey\Documents\GitHub\SolarSculptor\resources\testImage\GradientImg4Color.png")
panel = Panel(path)
timer = Timer(TimerInterval=1000, Target=python_script)
# Import Image
python_script = PythonScript(imagePath=panel, run=Toggle(True), step=Slider(44, range=0..100))  # -> out, redData, greenData, blueData, alphaData, xSize, ySize; inputs run: Boolean, step: Int32
# ---------- python_script: Python ----------
import os
from System import Object
import Grasshopper.Kernel as gh
from Grasshopper import DataTree
from Grasshopper.Kernel.Data import GH_Path
from System.Drawing import Image

redDataTree = DataTree[Object]()
greenDataTree = DataTree[Object]()
blueDataTree = DataTree[Object]()
alphaDataTree = DataTree[Object]()
redData = []
greenData = []
blueData =[]
alphaData=[]

if run:
    img = Image.FromFile(imagePath)
    for indexY, y in enumerate(range(0, img.Height,step)):

        yPath = GH_Path(indexY)
        for indexX, x in enumerate(range(0,img.Width, step)):
            colorData = img.GetPixel(x, y)
            redDataTree.Add(colorData.R/255, yPath)
            greenDataTree.Add(colorData.G/255, yPath)
            blueDataTree.Add(colorData.B/255, yPath)
            alphaDataTree.Add(colorData.A/255, yPath)
img.Dispose()
redData, greenData, blueData, alphaData = [redDataTree, greenDataTree, blueDataTree, alphaDataTree]
xSize = indexX; ySize = indexY
# ---------- end python_script ----------
square = Square(Plane=PlaneXY(0, 0, 0), Size=1, ExtentX=python_script.xSize, ExtentY=python_script.ySize)  # -> Cells, Points
deconstruct = Deconstruct(Point=square.Points)  # -> simplify(XComponent), simplify(YComponent), ZComponent

rectangle = Rectangle(Plane=PlaneXY(0, 0, 0), XSize=python_script.xSize, YSize=python_script.ySize, Radius=0)  # -> Rectangle, Length
mplane = MeshPlane(Boundary=rectangle.Rectangle, WidthCount=python_script.ySize, HeightCount=python_script.ySize)  # -> Mesh, Area
flip = FlipMatrix(Data=python_script.redData)
meshselector = Ladybug_MeshThresholdSelector(inputMesh=mplane.Mesh, analysisResult=flatten(flip), operator=">", levelOfPerform=Slider(0.09, range=0..0.5))  # -> readMe, totalValue, areaMeetsThresh, newColoredMesh, newMeshOutline; plug-in component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

multiplication = Multiplication(A=python_script.blueData, B=Slider(4, range=1..50))
construct_point = ConstructPoint(XCoordinate=deconstruct.XComponent, YCoordinate=deconstruct.YComponent, ZCoordinate=multiplication)
interpolate = Interpolate(Vertices=construct_point, Degree=3, Periodic=False, KnotStyle=1)  # -> Curve, Length, Domain
loft = Loft(
    Curves=flatten(interpolate.Curve),
    Options={Adjust=False, Closed=False, LoftEnds=0, LoftSimp=0, LoftType=0, Rebuild=10, Refit=0.01})
demesh = DeconstructMesh(Mesh=meshselector.newColoredMesh)  # -> Vertices, Faces, Colours, Normals
