# Grasshopper definition LANDSAT_Thermal_Image_Importer.gh (Grasshopper 0.9.76)
# plug-ins: Python Interpreter

# ----
# Center the Image on the EPW latitude / longitude
san_francisco_epw = Panel("https://www.energyplus.net/weather-download/north_and_central_america_wmo_region_4/USA/CA/USA_CA_San.Francisco.Intl.AP.724940_TMY3/all")
epw_stat = Ladybug_OpenEPWAndSTATWeatherFiles(weatherFileURL=san_francisco_epw)  # -> epwFile, statFile; plug-in component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
importlocation = Ladybug_ImportLocation(epwFile=epw_stat.epwFile)  # -> location; plug-in component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
explodelocation = Ladybug_DecomposeLocation(location=importlocation)  # -> locationName, latitude, longitude, timeZone, elevation; plug-in component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

ladybug = Ladybug_Ladybug()  # -> Vviiiiiiiiiizzz; plug-in component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
dragonfly = Dragonfly_Dragonfly()  # -> Vviiiiiiiiiizzz; plug-in component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

# ----
# Customize with LegendPar
panel = Panel("20")
legendpar = Ladybug_LegendParameters(lowBound=panel, highBound="40", numSegments="11", legendScale="0.75", decimalPlaces="0")  # -> legendPar; plug-in component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

# ----
# Set to LANDSAT Filepath
file_path_to_the_landsat_directory = Panel("C:\Users\mackey\Desktop\DF\TestLANDSAT\SanFran_June_2011")
# Import Image
toggle = BooleanToggle(False)
km_width_length = Panel("40")
pixels_to_skip = Panel("4")

importlandsatimg = Dragonfly_ImportLANDSATImage(
    landsatImgFolder=file_path_to_the_landsat_directory,
    latitude=explodelocation.latitude,
    longitude=explodelocation.longitude,
    imageWidth=km_width_length,
    imageHeight=km_width_length,
    sampleSize=pixels_to_skip,
    legendPar=legendpar,
    runIt=toggle)  # -> readMe, values, geoTiffPts, ptColors, port, legend, legendBasePt, title, titleBasePt; plug-in component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
preview = CustomPreview(Geometry=importlandsatimg.geoTiffPts, Shader=importlandsatimg.ptColors)
geo = Geometry(importlandsatimg.legend)
